# Requirement set StakeholderRequirement_Func (R2024b)

## 1 [#1] Operating Environment (Container)

### 1.1 [STAKEHOLDER -02] Environment
The ventilator shall be designed for indoor use.

### 1.2 [STAKEHOLDER -03] Operating Temperature
The ventilator should operate within an ambient temperature range of 15°C - 32°C.

### 1.3 [STAKEHOLDER -04] Operating Pressure
The ventilator shall operate at standard ambient pressure.

## 2 [#2] Performance

### 2.1 [STAKEHOLDER -05] Operating Time
The ventilator shall be able to operate continuously for 120 minutes if it is in battery mode.

### 2.2 [STAKEHOLDER -06] Manual Control

## 3 [#3] System Size

## 4 [#4] System Cost
The cost of the ventilator shall not exceed $10000.

## 5 [#5] Mass
The mass of the ventilator shall not exceed 15 kg.

## 6 [#6] Safety

## 7 [#7] Reliability

## 8 [#13] Patient Breathing (Container)

### 8.1 [STAKEHOLDER - 07] Humidification
Inhale gas shall be humidified by using either an active or passive device