# Requirement set VentilatorRequirements_Jama (R2024b)

## 1 [VentilatorRequirements] (Container)

### 1.1 [RL1] General Requirements (Container)
CreatedBy: ppatel
CreatedOn: 2024-04-19T00:45:28
ModifiedBy: ppatel
ModifiedOn: 2024-04-19T00:48:26

#### 1.1.1 [RL1.1] Safety
Ventilators must be designed to protect patients from electric shock, mechanical hazards, and excessive outputs of pressure (35 cmH2O) and volume
CreatedBy: ppatel
CreatedOn: 2024-04-19T00:46:21
ModifiedBy: ppatel
ModifiedOn: 2024-04-19T00:49:26

#### 1.1.2 [RL1.2] Environmental conditions
The ventilator should function safely within a specified range of environmental conditions, including temperature and humidity
CreatedBy: ppatel
CreatedOn: 2024-04-19T00:48:26
ModifiedBy: ppatel
ModifiedOn: 2024-04-19T00:49:45

### 1.2 [RL2.1] Mode & Operation (Container)
CreatedBy: ppatel
CreatedOn: 2024-04-19T00:51:12
ModifiedBy: ppatel
ModifiedOn: 2024-04-19T00:58:01

#### 1.2.1 [RL2.1.1] Operating mode
The ventilator shall allow changing the ventilation mode while ventilation support is inactive or active
CreatedBy: ppatel
CreatedOn: 2024-04-19T00:51:51
ModifiedBy: ppatel
ModifiedOn: 2024-04-19T00:52:12

#### 1.2.2 [RL2.1.2] Start/Stop
The ventilator shall provide switch input to allow start/stop ventilation operation
CreatedBy: ppatel
CreatedOn: 2024-04-19T00:52:12
ModifiedBy: ppatel
ModifiedOn: 2024-04-19T00:55:02

#### 1.2.3 [RL2.1.3] Monitoring
The ventilator shall provide monitoring switch to allow display all essential patient vitals such as tidal volume, pressure, flow, inhale/exhale time
CreatedBy: ppatel
CreatedOn: 2024-04-19T00:55:41
ModifiedBy: ppatel
ModifiedOn: 2024-04-19T00:56:04

#### 1.2.4 [RL2.1.4] Press control
The pressure controller ventilator shall be operate within a range of 5 to 50 cm H2O
CreatedBy: ppatel
CreatedOn: 2024-04-19T00:56:04
ModifiedBy: ppatel
ModifiedOn: 2024-04-19T00:56:24

#### 1.2.5 [RL2.1.5] PEEP adjustment
The ventilation modes that utilizes PEEP adjustment shall range between 5 to 10 cmH2O
CreatedBy: ppatel
CreatedOn: 2024-04-19T00:56:24
ModifiedBy: ppatel
ModifiedOn: 2024-04-19T00:56:41

#### 1.2.6 [RL2.1.6] Breath rate
The ventilation modes that utilizes breath rate shall range between 1 to 60 breath/min
CreatedBy: ppatel
CreatedOn: 2024-04-19T00:56:41
ModifiedBy: ppatel
ModifiedOn: 2024-04-19T00:56:58

#### 1.2.7 [RL2.1.7] Insp time
The Inspirational time adjustment range shall be 0.3s to 2.4s with an I/E ratio not exceeding 1/2 for pressure controlled ventilator
CreatedBy: ppatel
CreatedOn: 2024-04-19T00:56:58
ModifiedBy: ppatel
ModifiedOn: 2024-04-19T00:57:21

#### 1.2.8 [RL2.1.8] Pressure level
The rise time adjustment range shall allow 6 levels. The associated quantitative rise times will adapt to inspiration time and the adjusted inspiratory pressure value
CreatedBy: ppatel
CreatedOn: 2024-04-19T00:57:21
ModifiedBy: ppatel
ModifiedOn: 2024-04-19T00:57:39

#### 1.2.9 [RL2.1.9] Heater wire humidifier
The temperature along the inspiratory limb shall be monitored and controlled at 34degC in the non-invasive mode and 40degC in the invasive mode
CreatedBy: ppatel
CreatedOn: 2024-04-19T00:57:39
ModifiedBy: ppatel
ModifiedOn: 2024-04-19T00:58:01

#### 1.2.10 [RL2.1.10] Humidity requirement
The ventilator shall deliver gas with 50% relative humidity with absolute humidity of 10mg/L at 22degC at nose/mouth
CreatedBy: ppatel
CreatedOn: 2024-04-19T00:58:01
ModifiedBy: ppatel
ModifiedOn: 2024-04-19T00:58:21

### 1.3 [RL2.2] Display (Container)
CreatedBy: ppatel
CreatedOn: 2024-04-19T00:58:26
ModifiedBy: ppatel
ModifiedOn: 2024-04-19T00:58:47

#### 1.3.1 [RL2.2.1] Patient monitoring
The ventilator should provide monitoring capabilities for patient parameters such as pressure, volume, and gas concentration
CreatedBy: ppatel
CreatedOn: 2024-04-19T00:58:53
ModifiedBy: ppatel
ModifiedOn: 2024-04-19T00:59:13

### 1.4 [RL2.3] Alarms (Container)
CreatedBy: ppatel
CreatedOn: 2024-04-19T00:59:14
ModifiedBy: ppatel
ModifiedOn: 2024-04-19T01:01:09

#### 1.4.1 [RL2.3.1] Operating mode short circuit
Operating mode dial switch logic shall able to detect shorted high or ground faults
CreatedBy: ppatel
CreatedOn: 2024-04-19T00:59:45
ModifiedBy: ppatel
ModifiedOn: 2024-04-19T01:00:08

#### 1.4.2 [RL2.3.2] Pressure fault
Pressure sensor reading shall not fall below 5 or rise above 50 cmH2O while ventilation support is active
CreatedBy: ppatel
CreatedOn: 2024-04-19T01:00:12
ModifiedBy: ppatel
ModifiedOn: 2024-04-19T01:00:44

#### 1.4.3 [RL2.3.3] Occlusion
The ventilator shall initiate a high priority alarm if no significant volume can be delivered to the patient while the target pressure is reached
CreatedBy: ppatel
CreatedOn: 2024-04-19T01:00:44
ModifiedBy: ppatel
ModifiedOn: 2024-04-19T01:01:09

#### 1.4.4 [RL2.3.4] Alarm failure
The ventilator shall initiate a high priority alarm if the primary audio/visual alarm system is not delivering alarm signal
CreatedBy: ppatel
CreatedOn: 2024-04-19T01:01:09
ModifiedBy: ppatel
ModifiedOn: 2024-04-19T01:01:30

### 1.5 [RL2.4] Controls (Container)
CreatedBy: ppatel
CreatedOn: 2024-04-19T01:01:35
ModifiedBy: ppatel
ModifiedOn: 2024-04-19T01:05:05

#### 1.5.1 [RL2.4.1] PID rise time
PID shall be tuned to have controller rise time < 10sec
CreatedBy: ppatel
CreatedOn: 2024-04-19T01:03:33
ModifiedBy: ppatel
ModifiedOn: 2024-04-19T01:10:25