% Simulink data dictionary Humidifier_Interface.sldd

Humidity = Simulink.Bus()
  Room_H: double
  Humidifier_H: double
  Insp_Humidity: double
  CondLvl: double

Thermistor = Simulink.Bus()
  Room_T: double
  Water_T: double
  heatedWire_T: double

Command = Simulink.Bus()
  Humidity: double
  Heater: double